# Grasshopper definition voronoi.gh (Grasshopper 1.0.7)
# plug-ins: Weaverbird

number_slider = Slider(5, range=2..10)
width = Slider(0, range=0..1)
thickness = Slider(0.251, range=0.2..1.5)
seed = Slider(359, range=0..500)
box = Box({Plane=PlaneXY(0, 0, 0), X=Domain(0, 10), Y=Domain(0, 10), Z=Domain(0, 10)})
python_hash = PythonScript(x=seed)  # -> out, a
# ---------- python_hash: Python ----------
secret = 66238732490534009356485427134777367
a = hash((x,secret))
# ---------- end python_hash ----------
python_date_hr = PythonScript(x=seed)  # -> out, a
# ---------- python_date_hr: Python ----------
# returns time in min

import time
seconds = time.time()
minutes = seconds / 60
a = round(minutes)
# ---------- end python_date_hr ----------
join = TextJoin(Text=[python_date_hr.a, number_slider, seed, width])
pop3d = Populate3D(Region=box, Count=number_slider, Seed=python_hash.a)
area = Area(Geometry=box)  # -> Area, Centroid
panel = Panel(join)
vcell = VoronoiCell(Point=area.Centroid, Neighbours=pop3d)
debrep = DeconstructBrep(Brep=vcell)  # -> Faces, Edges, Vertices
crv = Curve(debrep.Faces)
wbframe = WeaverbirdsPictureFrame(MeshPolylines=crv, Distance=5, InsetType=0)
wboffset = WeaverbirdsOffsetMesh(MeshCurves=wbframe, Distance=width, OffsetType=0)
wbcatmullclark = WeaverbirdsCatmullClarkSubdivision(MeshCurves=wboffset, Level=3, SmoothNakedEdges=1)
wbthicken = WeaverbirdsMeshThicken(MeshCurves=wbcatmullclark, Distance=thickness, OffsetType=0)
